# Dynamo custom node DynanimatorFunction Element Color.dyf (Dynamo 0.7.5.3566)
# category: Dynanimator.Functions
# Helper function for Dynanimate Element Color

Elements = Input()
Start_Color = Input()
End_Color = Input()
Total_Iterations = Input()
Iteration = Input()
code_block = CodeBlock(n=Total_Iterations, iteration=Iteration) { 1/n*iteration; }
color_range = ColorRange(Start_Color, End_Color, code_block)
overrideColorInView = Element.OverrideColorInView(Elements, color_range)
end = Revit.Transaction.Transaction.End(overrideColorInView)
Directory_Path = Input()
current = Document.Current()
activeView = Document.ActiveView(current)
dynanimatorfunctionhelper = Custom[DynanimatorFunctionHelper ExportAsImage](Iteration=Iteration, Directory_Path=Directory_Path, view=activeView)  # Exports Current Iteration Step as Image
end_2 = Revit.Transaction.Transaction.End(dynanimatorfunctionhelper)
compose = ComposeFunctions(end, end_2)  # "Function.Compose"
