# Dynamo custom node DynanimatorFunction Numeric Parameter.dyf (Dynamo 0.7.5.3566)
# category: Dynanimator.Functions
# Helper function for Dynanimate Numeric Parameter

Elements = Input()
Parameter_Name = Input()
Min_Param_Value = Input()
Max_Param_Value = Input()
Total_Iterations = Input()
Iteration = Input()
code_block = CodeBlock(min=Min_Param_Value, max=Max_Param_Value, n=Total_Iterations, iteration=Iteration) { min + (max-min)/n*iteration; }
setParameterByName = Element.SetParameterByName(Elements, Parameter_Name, code_block)
end = Revit.Transaction.Transaction.End(setParameterByName)
func = Output(end)
