# Dynamo custom node DynanimatorFunction Phases.dyf (Dynamo 0.7.5.3566)
# category: Dynanimator.Functions
# Helper function for Dynanimate Phases

View = Input()
Phases = Input()
Phase_Index = Input()
code_block = CodeBlock(seq=Phases, i=Phase_Index) { seq[i]; }
setPhase = Custom[View.SetPhase](View_s=View, Phase=code_block)  # Sets the phase of a given view
end = Revit.Transaction.Transaction.End(setPhase.View_s)
Directory_Path = Input()
dynanimatorfunctionhelper = Custom[DynanimatorFunctionHelper ExportAsImage](Iteration=code_block, Directory_Path=Directory_Path, view=View)  # Exports Current Iteration Step as Image
end_2 = Revit.Transaction.Transaction.End(dynanimatorfunctionhelper)
compose = ComposeFunctions(end, end_2)  # "Function.Compose"
