# Dynamo custom node DynanimatorFunction Target Position With Fixed Camera.dyf (Dynamo 0.7.5.3566)
# category: Dynanimator.Functions
# Helper function for Dynanimate Target Position With Fixed Camera Position

View = Input()
Camera_Position = Input()
Target_Path = Input()
Total_Iterations = Input()
Iteration = Input()
code_block = CodeBlock(n=Total_Iterations, iteration=Iteration) { 1/n*iteration; }
pointAtParameter = Curve.PointAtParameter(Target_Path, code_block)
setOrientationByEyeAndTargetPosition = Custom[PerspectiveView.SetOrientationByEyeAndTargetPosition](View=View, Eye_Position=Camera_Position, Target_Position=pointAtParameter)  # Sets the orientation of a given perspective view based on a given eye and target position
end = Revit.Transaction.Transaction.End(setOrientationByEyeAndTargetPosition)
Directory_Path = Input()
dynanimatorfunctionhelper = Custom[DynanimatorFunctionHelper ExportAsImage](Iteration=Iteration, Directory_Path=Directory_Path, view=View)  # Exports Current Iteration Step as Image
end_2 = Revit.Transaction.Transaction.End(dynanimatorfunctionhelper)
compose = ComposeFunctions(end, end_2)  # "Function.Compose"
