# Dynamo custom node DynanimatorNestedFunction Numeric Parameter And Camera Position With Fixed Target.dyf (Dynamo 0.7.5.3566)
# category: Dynanimator.Functions
# Nested function used in DynanimatorFunction Numeric Parameter And Camera Position With Fixed Target

Elements = Input()
Parameter_Name = Input()
Min_Value = Input()
Max_Value = Input()
Total_Iterations = Input()
Iteration = Input()
code_block = CodeBlock(min=Min_Value, max=Max_Value, n=Total_Iterations, iteration=Iteration) { min + (max-min)/n*iteration; }
setParameterByName = Element.SetParameterByName(Elements, Parameter_Name, code_block)
View = Input()
Camera_Path = Input()
code_block_2 = CodeBlock(n=Total_Iterations, iteration=Iteration) { 1/n*iteration; }
pointAtParameter = Curve.PointAtParameter(Camera_Path, code_block_2)
Target_Position = Input()
setOrientationByEyeAndTargetPosition = Custom[PerspectiveView.SetOrientationByEyeAndTargetPosition](View=View, Eye_Position=pointAtParameter, Target_Position=Target_Position)  # Sets the orientation of a given perspective view based on a given eye and target position
create = List.Create(setParameterByName, setOrientationByEyeAndTargetPosition)
list = Output(create)
