# Dynamo custom node DynanimatorFunction Phases (As CloudRendering).dyf (Dynamo 0.7.5.3566)
# category: Dynanimator._Functions_.CloudRendering
# Helper function for Dynanimate Phases (As CloudRendering)

Phase_Index = Input()
Phases = Input()
code_block = CodeBlock(seq=Phases, i=Phase_Index) { seq[i]; }
name = Element.Name(code_block)
code_block_2 = CodeBlock(num=Phase_Index, phase_name=name) { num + "_" + phase_name; }
View = Input()
setPhase = Custom[View.SetPhase](View_s=View, Phase=code_block)  # Sets the phase of a given view
end = Revit.Transaction.Transaction.End(setPhase.View_s)
Width = Input()
Height = Input()
RenderType = Input()
RenderQuality = Input()
emailMe = Input()
dynanimatorfunctionhelper = Custom[DynanimatorFunctionHelper CloudRender](NameSuffix_opt=code_block_2, View=end, Width=Width, Height=Height, RenderType=RenderType, RenderQuality=RenderQuality, emailMe=emailMe)  # Renders current iteration step in the cloud (Credits required)
func = Output(dynanimatorfunctionhelper)
