# Dynamo custom node DynanimatorFunctionHelper ExportAsImage.dyf (Dynamo 0.7.5.3566)
# category: Dynanimator._Helpers_
# Exports current iteration step as image

View = Input()
Directory_Path = Input()
string = StringInput("\")
NameSuffix_opt = Input()  # "NameSuffix (opt)"
code_block = CodeBlock(num=NameSuffix_opt) { num; }
isNull = Object.IsNull(code_block)
string_2 = StringInput("")
if_ = If(isNull, string_2, code_block)
string_from_object = FromObject(if_)
string_3 = StringInput(".png")
concat = String.Concat(Directory_Path, string, string_from_object, string_3)
exportAsImage = View.ExportAsImage(View, concat)
output = Output(exportAsImage)  # "[]"
